# Dynamo graph roomEdge.dyn (Dynamo 1.3.2.2480)

categories = Categories("Rooms")
all_elements_of_category = ElementsOfCategory(categories)
geometry = Element.Geometry(all_elements_of_category)
edges = Face.Edges(geometry)
watch = Watch(edges)
code_block = CodeBlock()
# ---------- code_block.designscript (14 lines) ----------
"
import clr
clr.AddReference('ProtoGeometry')
from Autodesk.DesignScript.Geometry import Face

rooms = IN[0]
edges = []

for room in rooms:
    for geom in room.Geometry():
        edges.append(geom.Edges)

OUT = edges
";
# ----------------------------------------
python_script_from_string = PythonStringNode(script=code_block, IN[0]=all_elements_of_category)
watch_2 = Watch(python_script_from_string)
